% Simulink data dictionary global_data_mc.sldd

GBL_TRUE = Simulink.Parameter(1, StorageClass="ExportedGlobal", DataType="boolean", Min=1, Max=1, Unit="bool")
GBL_FALSE = Simulink.Parameter(0, StorageClass="ExportedGlobal", DataType="boolean", Min=0, Max=0, Unit="bool")